# Grasshopper definition Lilypad.gh (Grasshopper 1.0.8)

divot_width = Slider(0.4, range=0..1)
cardboard_width_lily = Slider(0.035, range=0.03..0.1)
lilypad_radius = Slider(1, range=1..5)

fillet_radius = Slider(0.046, range=0..0.1)
circle = Circle(Plane=PlaneXY(0, 0, 0), Radius=lilypad_radius)
amt_over_edge = Slider(0.03, range=0..0.1)

# ---- group: Slot
number_slider = Slider(-1, range=-1.001..-1)
slot_depth = Slider(0.4, range=0.399..0.4)
number_slider_2 = Slider(-0.5, range=-0.501..-0.5)
multiplication = Multiplication(A=lilypad_radius, B=number_slider)
_0_5 = Multiplication(A=number_slider_2, B=slot_depth)
_0_5_2 = Multiplication(A=number_slider_2, B=cardboard_width_lily)
slot = Rectangle(Plane=PlaneXY(0, 0, 0), XSize=cardboard_width_lily, YSize=slot_depth, Radius=fillet_radius)  # -> Rectangle, Length
divot_v = VectorXYZ(XComponent=multiplication, YComponent=0, ZComponent=0)  # -> Vector, Length
slot_v = VectorXYZ(XComponent=_0_5_2, YComponent=_0_5, ZComponent=0)  # -> Vector, Length
center_slot = Move(Geometry=slot.Rectangle, Motion=slot_v.Vector)  # -> Geometry, Transform
radius_minus_slot_length = Subtraction(A=lilypad_radius, B=slot_v.Length)
number_slider_3 = Slider(-1, range=-1.001..-1)
value_list = ValueList({"30 degrees": 30*pi/180, "-30 degrees": -30*pi/180}, selected="30 degrees")
value_list_2 = ValueList({"30 degrees": 30*pi/180, "-30 degrees": -30*pi/180}, selected="-30 degrees")
_1 = Slider(1, range=0..1)
origin = VectorXYZ(XComponent=0, YComponent=0, ZComponent=0)  # -> Vector, Length
value_list_3 = ValueList({"30 degrees": 30*pi/180, "-30 degrees": -30*pi/180}, selected="-30 degrees")
value_list_4 = ValueList({"30 degrees": 30*pi/180, "-30 degrees": -30*pi/180}, selected="30 degrees")
Z = VectorXYZ(XComponent=0, YComponent=0, ZComponent=_1)  # -> Vector, Length
z_line = Line(StartPoint=origin.Vector, EndPoint=Z.Vector)

# ---- group: Divot
divot_n_sides = Slider(3, range=2.999..3)
divot = Polygon(Plane=PlaneXY(0, 0, 0), Radius=lilypad_radius, Segments=divot_n_sides, FilletRadius=0)  # -> Polygon, Length
scale_divot = ScaleNU(Geometry=divot.Polygon, Plane=PlaneXY(0, 0, 0), ScaleX=1, ScaleY=divot_width, ScaleZ=1)  # -> Geometry, Transform
move_divot = Move(Geometry=scale_divot.Geometry, Motion=divot_v.Vector)  # -> Geometry, Transform

# ----
plus_over_edge = Addition(A=amt_over_edge, B=radius_minus_slot_length)

# ---- group: Slot (continued)
slot_at_edge_v = VectorXYZ(XComponent=0, YComponent=plus_over_edge, ZComponent=0)  # -> Vector, Length
multiplication_2 = Multiplication(A=slot_at_edge_v.Vector, B=number_slider_3)
move_slot_to_edge = Move(Geometry=center_slot.Geometry, Motion=slot_at_edge_v.Vector)  # -> Geometry, Transform
move_slot_to_edge_2 = Move(Geometry=center_slot.Geometry, Motion=multiplication_2)  # -> Geometry, Transform
rotate_slot = RotateAxis(Geometry=move_slot_to_edge.Geometry, Angle=value_list, Axis=z_line)  # -> Geometry, Transform
rotate_slot_2 = RotateAxis(Geometry=move_slot_to_edge.Geometry, Angle=value_list_2, Axis=z_line)  # -> Geometry, Transform
rotate_slot_3 = RotateAxis(Geometry=move_slot_to_edge_2.Geometry, Angle=value_list_3, Axis=z_line)  # -> Geometry, Transform
rotate_slot_4 = RotateAxis(Geometry=move_slot_to_edge_2.Geometry, Angle=value_list_4, Axis=z_line)  # -> Geometry, Transform

# ----
diff_triangle = RegionDifference(CurvesA=circle, CurvesB=move_divot.Geometry)
region_difference = RegionDifference(CurvesA=diff_triangle, CurvesB=rotate_slot.Geometry)
region_difference_2 = RegionDifference(CurvesA=region_difference, CurvesB=rotate_slot_2.Geometry)
region_difference_3 = RegionDifference(CurvesA=region_difference_2, CurvesB=rotate_slot_4.Geometry)
bake_me = RegionDifference(CurvesA=region_difference_3, CurvesB=rotate_slot_3.Geometry)
